# Grasshopper definition 3DPv2_NON_planar_260807.gh (Grasshopper 1.0.8)
# plug-ins: WASPer_3DP

crv = Curve(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)
crv_2 = Curve(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)
bbox = BoundingBox(Content=flatten([crv, crv_2]), Plane=PlaneXY(0, 0, 0), UnionBox=True)  # -> Box, Box_2
area = Area(Geometry=bbox.Box)  # -> Area, Centroid
pdecon = Deconstruct(Point=area.Centroid)  # -> XComponent, YComponent, ZComponent
pt = ConstructPoint(XCoordinate=pdecon.XComponent, YCoordinate=pdecon.YComponent, ZCoordinate=0)
orient = Orient(Geometry=flatten([crv, crv_2]), Source=pt, Target=PlaneXY(0, 0, 0))  # -> Geometry, Transform
item = ListItem(List=orient.Geometry, Index=0, Wrap=True)  # -> Item, Item1
mm = Panel("6")
mm_2 = Panel("2")

layer_height = Data(mm_2)
layer_width = Data(mm)

layer_height_2 = Data(layer_height)

# ----
# 1. Non-Planar Printing Path - Snippet provided by Ionut Anton (Mincu Bucharest)
crv_3 = Curve(item.Item)
crv_4 = Curve(item.Item1)
number_slider = Slider(50, range=0..100)
divide = DivideCurve(Curve=crv_3, Count=number_slider, Kinks=False)  # -> Points, Tangents, Parameters
divide_2 = DivideCurve(Curve=crv_4, Count=number_slider, Kinks=False)  # -> Points, Tangents, Parameters
pdecon_2 = Deconstruct(Point=divide.Points)  # -> XComponent, YComponent, ZComponent
pdecon_3 = Deconstruct(Point=divide_2.Points)  # -> XComponent, YComponent, ZComponent
bnd = Bounds(Numbers=pdecon_2.ZComponent)
bnd_2 = Bounds(Numbers=pdecon_3.ZComponent)
dedomain = DeconstructDomain(Domain=bnd)  # -> Start, End
dedomain_2 = DeconstructDomain(Domain=bnd_2)  # -> Start, End
subtraction = Subtraction(A=dedomain.End, B=dedomain_2.Start)
subtraction_2 = Subtraction(A=dedomain.Start, B=dedomain_2.Start)
division = Division(A=subtraction, B=layer_height_2)
int = Integer(division)
division_2 = Division(A=subtraction_2, B=int)
range = Range(Domain=Domain(0, 1), Steps=int)
minimum_layer_height = Panel(division_2)
number_of_layers = Panel(int)

tweencrv = TweenCurve(CurveA=crv_4, CurveB=crv_3, Factor=range, BlendType=0)  # -> simplify(graft(Tween))

non_planar_printing_path_crvs = Data(tweencrv)
path_role = Wsp_Sl08_AssignPathRole(Path_curves=non_planar_printing_path_crvs, Path_role=flatten(1))  # -> Tagged_curves, Summary

printing_path_crvs = Data(path_role.Tagged_curves)

# ----
# Toolpath Display
toggle = BooleanToggle(False)
# WASPer uses roles:
# Roles classify each printing path by its fabrication function,
# allowing WASPer to selectively visualize, modify, analyze,
# or export specific parts of the toolpath. The roles are:
# 
# 0 = Undefined
# 1 = Shell
# 2 = Infill
# 3 = Partition 4 = Support
printing_path_crvs_2 = Data(printing_path_crvs)
layer_height_3 = Data(layer_height)
layer_width_2 = Data(layer_width)
ppath_vis = Wsp_Sl07_VisualizePrintingPath(
    P_path_curves=printing_path_crvs_2,
    Layer_h=layer_height_3,
    Layer_w=layer_width_2,
    High_res=invert(False),
    Mesh=True,
    wsp_sl07_palette_index=0,
    wsp_sl07_visible_roles_mask=63)  # -> P_path_mesh, P_path_colour, P_path_role
normalshade = Wsp_Ut15_ShadeMeshByNormals(Mesh=ppath_vis.P_path_mesh, wsp_ut15_show_all_outputs=False)

flowdef = Wsp_Pp05_DefineFlow(Flow_mode=1, M1_flow=flatten(1), M2_m3_flow_range=flatten(1), Reverse_crv=False, Target_roles=flatten(0))  # -> Flow_params, Summary

layer_height_4 = Data(layer_height)
layer_width_3 = Data(layer_width)

# ----
# 2. Generate Points (Coordinates) and flux mult
number_slider_2 = Slider(0, range=0..1)
printing_path_crvs_3 = Data(printing_path_crvs)
pathcrvs_v2 = Wsp_Pp01_WASPerPathFromCurvesV2(
    Printing_path=printing_path_crvs_3,
    Segment_len="2",
    Ref_plane=PlaneXY(0, 0, 0),
    Layer_w=layer_width_3,
    Plane_mode=number_slider_2,
    WASPer_Pp01v3_ShellSeamDisplay=18,
    WASPer_Pp01v3_ShellSeamFrom=0,
    WASPer_Pp01v3_ShellSeamOverrides="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",
    WASPer_Pp01v3_ShellSeamScope=0,
    WASPer_Pp01v3_ShellSeamTo=0,
    wsp_gc01_v2_visible_outputs_mask=0)  # -> Wsp_path, Summary
wsp_path = Data(pathcrvs_v2.Wsp_path)

# ----
# 3. Optimize Printing Path:
# - Traveling Salesman Problem (TSP)
wsp_path_2 = Data(wsp_path)
path_optimizer = Wsp_Pp03_PrintingPathOptimizer(Wsp_path=wsp_path_2, Ref_point=null, Target_roles=flatten(0), wsp_gc05_visible_outputs_mask=0)  # -> Wsp_path, Summary
wsp_path_3 = Data(path_optimizer.Wsp_path)

opaque_mats = Wsp_Ma01_OpaqueMaterialsSolids()  # -> Wasper_mat, Mat_name, Prop_names, Prop_vals, Full_mat, Categories
custom_kpis = Wsp_Sm03_CustomKPIs(KPITypeName=opaque_mats.Mat_name, KPIHeaders=opaque_mats.Prop_names, KPIValues=opaque_mats.Prop_vals)  # -> CustomKPISet, Summary
mat_kpis = Data(custom_kpis.CustomKPISet)

# ----
# 4. (Optional Steps)
# - Reduce number of points in the path
# - Modify speeds by curvature.
# - Modify flow from proximity
wsp_path_4 = Data(wsp_path_3)
wsp_path_5 = Data(wsp_path_3)
wsp_path_6 = Data(wsp_path_3)
curvspeed = Wsp_Pp08_SpeedFromCurvature(
    Wsp_path=wsp_path_4,
    S_min="3000",
    S_max="5000",
    Curv_mode=0,
    Smooth_window=3,
    Curv_percentile=0.95,
    Norm_curv=False,
    Target_roles=flatten(0),
    wsp_gc08_visible_outputs_mask=0)  # -> Wsp_path, Summary
proxflow = Wsp_Pp15_FlowFromProximity(
    Wsp_path=wsp_path_6,
    Min_flux=0.6,
    Max_flux=1,
    D_crit=2,
    D_safe=6,
    Cluster_mode=2,
    Curv_threshold=0.3,
    Zone_half_width=2,
    Target_roles=flatten(0),
    wsp_gc06_visible_outputs_mask=0)  # -> Wsp_path, Summary
reduce_path_pls = Wsp_Pp07_ReducePathPoints(
    Wsp_path=wsp_path_5,
    Deviation_tol=0.5,
    Curv_angle=5,
    Max_spacing=0,
    Target_roles=flatten(0),
    wsp_gc07_visible_outputs_mask=0)  # -> Wsp_path, Summary
wsp_path_7 = Data(reduce_path_pls.Wsp_path)
wsp_path_8 = Data(curvspeed.Wsp_path)
wsp_path_9 = Data(proxflow.Wsp_path)

panel = Panel("""Sample information:
Sample Name...
Hello...""")

# ----
# 5. Generate Gcode from
# WASPer paths
mm_3 = Panel("4")
wasper_mat = Data(opaque_mats.Wasper_mat)
wsp_path_10 = Data(wsp_path_3)
nozzle_diam = Number(mm_3)
ldm_3dp_params = Wsp_Gc01_LDM3DPParameters(Nozzle_diameter=nozzle_diam, Z_hop="6", Wsp_mat=wasper_mat)  # -> _3dp_params, Info
marlin_gcode = Wsp_Gc03_MarlinGcodeV2(
    Wasper_path=wsp_path_10,
    _3dp_params=ldm_3dp_params._3dp_params,
    Sample_info=panel,
    Kpi_units=0,
    wsp_gc04_show_all_outputs=False)  # -> Wasper_path, G_code, Point_planes, Travel_planes
# If you have any doubts, suggestions, etc.. you can write to me via Linkedin!!
# :D
# or via mail juan.vargas@polito.it
wsp_path_11 = Data(marlin_gcode.Wasper_path)
gcode = Data(marlin_gcode.G_code)

panel_2 = Panel(gcode)
panel_3 = Panel(ldm_3dp_params._3dp_params)

panel_4 = Panel("""400
1000""")
wsp_path_12 = Data(wsp_path_11)
pt_2 = Point(Point(255.3702787, 189.8171267, 0))
panel_5 = Panel("1")
wasper_sim = Wsp_Gc05_WASPerSimulation(
    Wasper_path=wsp_path_12,
    Origin_plane=PlaneXY(0, 0, 0),
    Printer="1",
    Print_dimensions=panel_4,
    Preview_time=1,
    Start_time=0,
    Normalized=True,
    wsp_gc15_show_all_outputs=False)  # -> Printer_meshes, Wasper_path, Sim_path

# ----
# Rebuilding a Path from a Gcode!
# You can also load a Gcoede from a file
# and start all over!
gcode_2 = Data(gcode)
gc06_ppath = Wsp_Gc06_WASPerPathFromGcode(Gcode_text=gcode_2, Include_travels=True, wsp_gc13_show_all_outputs=False)  # -> Wasper_path, Gcode_p_path, Gcode_travels, Summary
layer_w = Data("6")
pathcrvs_v2_2 = Wsp_Pp01_WASPerPathFromCurvesV2(
    Printing_path=gc06_ppath.Gcode_p_path,
    Segment_len="4",
    Ref_plane=PlaneXY(0, 0, 0),
    Layer_w=layer_w,
    Plane_mode=0,
    WASPer_Pp01v3_ShellSeamDisplay=0,
    WASPer_Pp01v3_ShellSeamFrom=0,
    WASPer_Pp01v3_ShellSeamOverrides="{}",
    WASPer_Pp01v3_ShellSeamScope=0,
    WASPer_Pp01v3_ShellSeamTo=0,
    wsp_gc01_v2_visible_outputs_mask=0)  # -> Wsp_path, Summary

# ----
# Links
reprap_wiki_link = Panel("https://reprap.org/wiki/G-code")
marlin_link = Panel("https://marlinfw.org/meta/gcode/")
linkedin_profile_link = Panel("https://www.linkedin.com/in/juan-diego-vargas-vel/")
open_url = Wsp_Ut06_OpenURL(link=reprap_wiki_link, run=Button())  # inputs run: Boolean
# ---------- open_url: Python ----------
ghenv.Component.Name = "wsp_Ut06_Open URL"
ghenv.Component.Nickname = "Open url"
ghenv.Component.Message = "v1.0.4"
ghenv.Component.Cathegory = "WASPer_3DP"
ghenv.Component.Subcathegory = "1_Utils"
ghenv.Component.Description = "This utility component opens URLs"

import webbrowser

# Grasshopper inputs

# Function to open the link
def open_link(link):
    webbrowser.open(link)

# Check if the button is pressed and run only once
if run:
    if 'run_once' not in globals():
        run_once = False
    if not run_once:
        if link:
            open_link(link)
            run_once = True
else:
    run_once = False  # Reset the run_once flag when the button is not pressed
# ---------- end open_url ----------
open_url_2 = Wsp_Ut06_OpenURL(link=marlin_link, run=Button())  # inputs run: Boolean; same code as open_url
open_url_3 = Wsp_Ut06_OpenURL(link=linkedin_profile_link, run=Button())  # inputs run: Boolean; same code as open_url

# ----
# Toolpath Display
wsp_path_13 = Data(pathcrvs_v2_2.Wsp_path)
gcpath_vis = Wsp_Pp04_VisualizePrintPath(
    Wasper_path=wsp_path_13,
    Layer_w=0,
    High_res=False,
    Mesh=True,
    wsp_gc11_palette_index=0,
    wsp_gc11_visible_outputs_mask=0,
    wsp_gc11_visible_roles_mask=63)  # -> Gcode_mesh, Wasper_path, Dbg_paths, Dbg_profiles, Point_planes
mesh = Mesh(gcpath_vis.Gcode_mesh)
crv_5 = Curve(gcpath_vis.Dbg_paths)
crv_6 = Curve(gcpath_vis.Dbg_profiles)
preview = CustomPreview(Geometry=crv_6, Material=ColourSwatch(SwatchColor=RGB(0, 0, 0)))  # disabled
mjoin = MeshJoin(Meshes=mesh)

# ----
# 7. Create a WASPer Study to compare different options!!!
gcode_3 = Data(gcode)
wsp_path_14 = Data(wsp_path_11)
mat_kpis_2 = Data(mat_kpis)
kpis = Data(mat_kpis_2)
study_manager = Wsp_Sm01_WASPerStudyManager(
    Wsp_path=wsp_path_14,
    Kpi_sets=kpis,
    Gcode=gcode_3,
    cached_kpi_sources="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",
    disabled_kpi_groups="[]",
    editor_export_layout="Iterations in rows",
    editor_file_name="WASPer_Study_1",
    editor_format="All",
    fabrication_unit_mode=-1,
    kpi_group_order="[\"Fabrication\",\"Infill\",\"Clay_Gray_100_unfired\"]",
    manager_dpi=134,
    manager_height=640,
    manager_width=1304,
    manager_x=12,
    manager_y=62,
    sample_name_tokens="iteration;kpi:infill.cell_name_short;kpi:infill.cell_count_x;kpi:infill.cell_count_y;kpi:infill.cell_count_z",
    show_kpi_values=True,
    wasper_study_state_json="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",
    write_with_run=True)  # -> Kpi_set, Study_data, Files, Progress, Info

# ----
# Toolpath Display
# 6. Simulate Printing Process
printer_meshes = Mesh(wasper_sim.Printer_meshes)
robot_program = Data(wasper_sim.Sim_path)
wsp_path_15 = Data(wasper_sim.Wasper_path)

gcpath_vis_2 = Wsp_Pp04_VisualizePrintPath(
    Wasper_path=wsp_path_15,
    Layer_w=0,
    High_res=False,
    Sim_path=robot_program,
    Mesh=True,
    wsp_gc11_palette_index=1,
    wsp_gc11_visible_outputs_mask=0,
    wsp_gc11_visible_roles_mask=63)  # -> Gcode_mesh, Wasper_path, Dbg_paths, Dbg_profiles, Point_planes

crv_7 = Curve(gcpath_vis_2.Dbg_paths)
mesh_2 = Mesh(gcpath_vis_2.Gcode_mesh)
crv_8 = Curve(gcpath_vis_2.Dbg_profiles)
preview_2 = CustomPreview(Geometry=crv_8, Material=ColourSwatch(SwatchColor=RGB(0, 0, 0)))  # disabled

ghost_path = Wsp_Pp18_GhostPath(Wasper_path=gcpath_vis_2.Wasper_path)
normalshade_2 = Wsp_Ut15_ShadeMeshByNormals(Mesh=printer_meshes, wsp_ut15_show_all_outputs=False)
