# Grasshopper definition 3DPv2_Planar2_InfillsCrvs_Texture_260807.gh (Grasshopper 1.0.8)
# plug-ins: WASPer_3DP

# ----
# 0.1 Generate geometry from surfaces
# (Conformal)
crv = Curve([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])
# There are 3 types of layered
# infill parameters
# - 2D: Common infills used in 3DP
# - TPMS: with 8 types of them
# - Turtle paths: Trunc. Octahedron
panel = Panel("100")
Z = UnitZ(Factor=panel)
extr = Extrude(Base=crv, Direction=Z)

geo_type_2d = Slider(2, range=1..4)
turtle_params = Wsp_In13_TurtleInfillParamsLayered(
    P_width=4,
    Cell_count_tan="2",
    Cell_count_perp="1",
    Cell_count_z="1",
    Bridge_p_0=0,
    Bridge_p_1=1,
    Extend_ends=0,
    Teeth=False)
tpms_params = Wsp_In11_TPMSInfillParamsLayeredVolumetric(
    Type=Slider(2, range=0..7),
    Level=0,
    Count_x="2",
    Count_y="1",
    Count_z="1",
    Phase_x=0,
    Phase_y=0,
    Phase_z=0,
    Close_tpms=False,
    Invert_tpms=False)
_2d_params = Wsp_In12_2DInfillParamsLayered(Type=geo_type_2d, Flip=False, Count=Slider(4, range=4..10), Phase_shift=Slider(0, range=0..1))
tpms_params_2 = Data(tpms_params)
turtle_params_2 = Data(turtle_params)
_2d_params_2 = Data(_2d_params)

ref_geos = Geometry(extr)

slicer = Wsp_Sl01_Slicer(Geometry=ref_geos, Slicing_mode=1, Layer_h=2, Offset=0)  # -> Printing_path, B_box, Layer_planes

# ----
# 3 cavities!!
item = ListItem(List=slicer.Printing_path, Index=0, Wrap=True)  # -> Item, Item1
range = Range(Domain=Domain(0, 1), Steps="3")
tweencrv = TweenCurve(CurveA=item.Item, CurveB=item.Item1, Factor=range, BlendType=0)
ref_crvs_per_layer = Geometry(tweencrv)

# ----
# 3 Infill Params!!
_2d_params_3 = Data(_2d_params)
tpms_params_3 = Data(tpms_params_2)
turtle_params_3 = Data(turtle_params_2)
entwine = Entwine(Branch00=_2d_params_3, Branch01=tpms_params_3, Branch02=turtle_params_3, FlattenInputs=True)  # -> flatten(Result)
list_of_params = Data(entwine)

mm = Panel("6")
mm_2 = Panel("2")

layer_height = Data(mm_2)
layer_width = Data(mm)

# ----
# 1. Generate Infills
layered_multi_infill = Wsp_In10_LayeredMultiInfillFromCurves(
    Guide_curves=tweencrv,
    Infill_params=flatten(list_of_params),
    W_shell=layer_width,
    Longitudinal_clearance=layer_width,
    Guide_clearance=layer_width,
    Clearance_infill=expr("x*0.7", layer_width),
    Resolution=layer_height,
    Trim_layers=True,
    Close_shell=True,
    WASPer_In10v2_AppliedState="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",
    WASPer_In10v2_DisplayLayer=49,
    WASPer_In10v2_GuideDensity="{}",
    WASPer_In10v2_GuideWarp="{\"0\":[0.0,0.1942720620577119,0.46351046666117157,0.75,1.0],\"1\":[0.0,0.17704943489773425,0.25,0.38523398889594157,0.5,0.625,0.75,0.875,1.0],\"2\":[0.0,0.25,0.44447807630418473,0.75,1.0]}",
    WASPer_In10v2_LayerFrom=0,
    WASPer_In10v2_LayerGuideWarp="{}",
    WASPer_In10v2_LayerScope=0,
    WASPer_In10v2_LayerShellSeam="{}",
    WASPer_In10v2_LayerTo=49,
    WASPer_In10v2_Live=True,
    WASPer_In10v2_ShellSeam="{\"SeamU\":0.0,\"XSeam\":false,\"StartOffset\":7.234569549560547,\"EndOffset\":6.772805690765381,\"StartTangentialOffset\":-3.6280064582824707,\"EndTangentialOffset\":4.724964618682861,\"FilletRadius\":3.0}")  # -> Full_path, Layer_planes, Shell, Infill, Partitions, Contour_pts, Porosity_layer, Porosity_avg, Info, Infill_kpis
printing_path_crvs = Data(layered_multi_infill.Full_path)
la_planes = Data(layered_multi_infill.Layer_planes)
in_kpis = Data(layered_multi_infill.Infill_kpis)

# ----
# Toolpath Display
toggle = BooleanToggle(False)
# WASPer uses roles:
# Roles classify each printing path by its fabrication function,
# allowing WASPer to selectively visualize, modify, analyze,
# or export specific parts of the toolpath. The roles are:
# 
# 0 = Undefined
# 1 = Shell
# 2 = Infill
# 3 = Partition 4 = Support
printing_path_crvs_2 = Data(printing_path_crvs)
layer_height_2 = Data(layer_height)
layer_width_2 = Data(layer_width)
ppath_vis = Wsp_Sl07_VisualizePrintingPath(
    P_path_curves=printing_path_crvs_2,
    Layer_h=layer_height_2,
    Layer_w=layer_width_2,
    High_res=invert(False),
    Mesh=True,
    wsp_sl07_palette_index=0,
    wsp_sl07_visible_roles_mask=63)  # -> P_path_mesh, P_path_colour, P_path_role
normalshade = Wsp_Ut15_ShadeMeshByNormals(Mesh=ppath_vis.P_path_mesh, wsp_ut15_show_all_outputs=False)

flowdef = Wsp_Pp05_DefineFlow(Flow_mode=1, M1_flow=flatten(1), M2_m3_flow_range=flatten(1), Reverse_crv=False, Target_roles=flatten(0))  # -> Flow_params, Summary

layer_height_3 = Data(layer_height)
layer_width_3 = Data(layer_width)

# ----
# 2. Generate Points (Coordinates) and flux mult
number_slider = Slider(0, range=0..1)
printing_path_crvs_3 = Data(printing_path_crvs)
la_planes_2 = Data(la_planes)
pathcrvs_v2 = Wsp_Pp01_WASPerPathFromCurvesV2(
    Printing_path=printing_path_crvs_3,
    Layer_planes=la_planes_2,
    Segment_len="2",
    Ref_plane=PlaneXY(0, 0, 0),
    Layer_w=layer_width_3,
    Plane_mode=number_slider,
    WASPer_Pp01v3_ShellSeamDisplay=49,
    WASPer_Pp01v3_ShellSeamFrom=0,
    WASPer_Pp01v3_ShellSeamOverrides="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",
    WASPer_Pp01v3_ShellSeamScope=0,
    WASPer_Pp01v3_ShellSeamTo=0,
    wsp_gc01_v2_visible_outputs_mask=0)  # -> Wsp_path, Summary
wsp_path = Data(pathcrvs_v2.Wsp_path)

dom²num = ConstructDomain²(UMin="0.2", UMax="0.8", VMin="0.2", VMax="0.8")
ref_geos_2 = Geometry(extr)
number_slider_2 = Slider(2, range=2..4)
subsrf = Isotrim(Surface=reparameterize(ref_geos_2), Domain=dom²num)
divide = DivideDomain²(Domain=subsrf, UCount=number_slider_2, VCount=number_slider_2)
subsrf_2 = Isotrim(Surface=reparameterize(graft(subsrf)), Domain=divide)
layer_width_4 = Data(layer_width)
wsp_path_2 = Data(wsp_path)
area = Area(Geometry=subsrf_2)  # -> Area, Centroid
# You can use the Ghost Path to
# quickly visualize a WASPer Path
# without generating a Mesh
multiplication = Multiplication(A=layer_width_4, B=2)
fuzzy_pockets = Wsp_Pp13_FuzzyPocketsFromPoints(
    Wsp_path=wsp_path_2,
    PocketPoints=flatten(area.Centroid),
    HorizontalRadius=multiplication,
    VerticalRadius=multiplication,
    Depth=Slider(1, range=1..10),
    PocketType=0,
    Invert=False,
    wsp_gc19_constrain_infill=True,
    wsp_gc19_visible_outputs_mask=0)  # -> Wsp_path, Summary
ghost_path = Wsp_Pp18_GhostPath(Wasper_path=fuzzy_pockets.Wsp_path)

# ----
# Move Preview!
xy = XYPlane(Origin=Point(0, 0, 0))
pt = Point(Point(261.4702404, -163.834789, 0))
mesh_as_texture = Mesh(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)
ln = Line(StartPoint=xy, EndPoint=pt)

# ----
# Optional Step:
# Apply texture to shell
wsp_path_3 = Data(wsp_path)
# TO TURN OFF THE BLUE MESH
# CLICK HER AND DEACTIVE PREVIEW!!
# (BLUE BUTTON)
paint_fuzzy = Wsp_Pp14_FuzzySkinFromPaint(
    Wsp_path=wsp_path_3,
    BrushRadius=flatten(10),
    BrushStrength=flatten(0.181),
    SmoothStrength=flatten(1),
    BrushFalloff=flatten(2),
    Invert=flatten(False),
    MovePreview=flatten(ln),
    Texture=flatten(mesh_as_texture),
    wsp_gc20_constrain_infill=True,
    wsp_gc20_paint_live=True,
    wsp_gc20_paint_preview=True,
    wsp_gc20_paint_state_gzip="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",
    wsp_gc20_visible_outputs_mask=0)  # -> Wsp_path, ShellMesh, Summary
ghost_path_2 = Wsp_Pp18_GhostPath(Wasper_path=paint_fuzzy.Wsp_path)

number_slider_3 = Slider(2.8, range=0..8)
wsp_path_4 = Data(wsp_path)
panel_2 = Panel("""1
0
0
1""")
pattern_fuzzy = Wsp_Pp11_FuzzySkinFromPattern(
    Wsp_path=wsp_path_4,
    PointPattern=panel_2,
    Magnitude0=number_slider_3,
    Magnitude1=number_slider_3,
    Target_roles=flatten(Slider(1, range=0..3)),
    PullDistance=10,
    Invert=False,
    wsp_gc17_constrain_infill=True,
    wsp_gc17_visible_outputs_mask=0)  # -> Wsp_path, Summary
ghost_path_3 = Wsp_Pp18_GhostPath(Wasper_path=pattern_fuzzy.Wsp_path)

# ----
# 3. Optimize Printing Path:
# - Traveling Salesman Problem (TSP)
wsp_path_5 = Data(ghost_path_2)
path_optimizer = Wsp_Pp03_PrintingPathOptimizer(Wsp_path=wsp_path_5, Ref_point=null, Target_roles=flatten(0), wsp_gc05_visible_outputs_mask=0)  # -> Wsp_path, Summary
wsp_path_6 = Data(path_optimizer.Wsp_path)

opaque_mats = Wsp_Ma01_OpaqueMaterialsSolids()  # -> Wasper_mat, Mat_name, Prop_names, Prop_vals, Full_mat, Categories
custom_kpis = Wsp_Sm03_CustomKPIs(KPITypeName=opaque_mats.Mat_name, KPIHeaders=opaque_mats.Prop_names, KPIValues=opaque_mats.Prop_vals)  # -> CustomKPISet, Summary
mat_kpis = Data(custom_kpis.CustomKPISet)

# ----
# 4. (Optional Steps)
# - Reduce number of points in the path
# - Modify speeds by curvature.
# - Modify flow from proximity
wsp_path_7 = Data(wsp_path_6)
wsp_path_8 = Data(wsp_path_6)
wsp_path_9 = Data(wsp_path_6)
curvspeed = Wsp_Pp08_SpeedFromCurvature(
    Wsp_path=wsp_path_7,
    S_min="3000",
    S_max="5000",
    Curv_mode=0,
    Smooth_window=3,
    Curv_percentile=0.95,
    Norm_curv=False,
    Target_roles=flatten(0),
    wsp_gc08_visible_outputs_mask=0)  # -> Wsp_path, Summary
proxflow = Wsp_Pp15_FlowFromProximity(
    Wsp_path=wsp_path_8,
    Min_flux=0.6,
    Max_flux=1,
    D_crit=2,
    D_safe=6,
    Cluster_mode=2,
    Curv_threshold=0.3,
    Zone_half_width=2,
    Target_roles=flatten(0),
    wsp_gc06_visible_outputs_mask=0)  # -> Wsp_path, Summary
reduce_path_pls = Wsp_Pp07_ReducePathPoints(
    Wsp_path=wsp_path_9,
    Deviation_tol=0.5,
    Curv_angle=5,
    Max_spacing=0,
    Target_roles=flatten(0),
    wsp_gc07_visible_outputs_mask=0)  # -> Wsp_path, Summary
wsp_path_10 = Data(reduce_path_pls.Wsp_path)
wsp_path_11 = Data(curvspeed.Wsp_path)
wsp_path_12 = Data(proxflow.Wsp_path)

panel_3 = Panel("""Sample information:
Sample Name...
Hello...""")

# ----
# 5. Generate Gcode from
# WASPer paths
mm_3 = Panel("4")
wasper_mat = Data(opaque_mats.Wasper_mat)
wsp_path_13 = Data(wsp_path_6)
nozzle_diam = Number(mm_3)
ldm_3dp_params = Wsp_Gc01_LDM3DPParameters(Nozzle_diameter=nozzle_diam, Z_hop="6", Wsp_mat=wasper_mat)  # -> _3dp_params, Info
marlin_gcode = Wsp_Gc03_MarlinGcodeV2(
    Wasper_path=wsp_path_13,
    _3dp_params=ldm_3dp_params._3dp_params,
    Sample_info=panel_3,
    Kpi_units=0,
    wsp_gc04_show_all_outputs=False)  # -> Wasper_path, G_code, Point_planes, Travel_planes
# If you have any doubts, suggestions, etc.. you can write to me via Linkedin!!
# :D
# or via mail juan.vargas@polito.it
wsp_path_14 = Data(marlin_gcode.Wasper_path)
gcode = Data(marlin_gcode.G_code)

panel_4 = Panel(gcode)
panel_5 = Panel(ldm_3dp_params._3dp_params)

panel_6 = Panel("""400
1000""")
pt_2 = Point(Point(255.3702787, 189.8171267, 0))
wsp_path_15 = Data(wsp_path_14)
panel_7 = Panel("1")
wasper_sim = Wsp_Gc05_WASPerSimulation(
    Wasper_path=wsp_path_15,
    Origin_plane=PlaneXY(0, 0, 0),
    Printer="1",
    Print_dimensions=panel_6,
    Preview_time=1,
    Start_time=0,
    Normalized=True,
    wsp_gc15_show_all_outputs=False)  # -> Printer_meshes, Wasper_path, Sim_path

# ----
# Rebuilding a Path from a Gcode!
# You can also load a Gcoede from a file
# and start all over!
gcode_2 = Data(gcode)
gc06_ppath = Wsp_Gc06_WASPerPathFromGcode(Gcode_text=gcode_2, Include_travels=True, wsp_gc13_show_all_outputs=False)  # -> Wasper_path, Gcode_p_path, Gcode_travels, Summary
layer_w = Data("6")
pathcrvs_v2_2 = Wsp_Pp01_WASPerPathFromCurvesV2(
    Printing_path=gc06_ppath.Gcode_p_path,
    Segment_len="4",
    Ref_plane=PlaneXY(0, 0, 0),
    Layer_w=layer_w,
    Plane_mode=0,
    WASPer_Pp01v3_ShellSeamDisplay=0,
    WASPer_Pp01v3_ShellSeamFrom=0,
    WASPer_Pp01v3_ShellSeamOverrides="{}",
    WASPer_Pp01v3_ShellSeamScope=0,
    WASPer_Pp01v3_ShellSeamTo=0,
    wsp_gc01_v2_visible_outputs_mask=0)  # -> Wsp_path, Summary

# ----
# Links
reprap_wiki_link = Panel("https://reprap.org/wiki/G-code")
linkedin_profile_link = Panel("https://www.linkedin.com/in/juan-diego-vargas-vel/")
marlin_link = Panel("https://marlinfw.org/meta/gcode/")
open_url = Wsp_Ut06_OpenURL(link=reprap_wiki_link, run=Button())  # inputs run: Boolean
# ---------- open_url: Python ----------
ghenv.Component.Name = "wsp_Ut06_Open URL"
ghenv.Component.Nickname = "Open url"
ghenv.Component.Message = "v1.0.4"
ghenv.Component.Cathegory = "WASPer_3DP"
ghenv.Component.Subcathegory = "1_Utils"
ghenv.Component.Description = "This utility component opens URLs"

import webbrowser

# Grasshopper inputs

# Function to open the link
def open_link(link):
    webbrowser.open(link)

# Check if the button is pressed and run only once
if run:
    if 'run_once' not in globals():
        run_once = False
    if not run_once:
        if link:
            open_link(link)
            run_once = True
else:
    run_once = False  # Reset the run_once flag when the button is not pressed
# ---------- end open_url ----------
open_url_2 = Wsp_Ut06_OpenURL(link=marlin_link, run=Button())  # inputs run: Boolean; same code as open_url
open_url_3 = Wsp_Ut06_OpenURL(link=linkedin_profile_link, run=Button())  # inputs run: Boolean; same code as open_url

# ----
# Toolpath Display
wsp_path_16 = Data(pathcrvs_v2_2.Wsp_path)
gcpath_vis = Wsp_Pp04_VisualizePrintPath(
    Wasper_path=wsp_path_16,
    Layer_w=0,
    High_res=False,
    Mesh=True,
    wsp_gc11_palette_index=0,
    wsp_gc11_visible_outputs_mask=0,
    wsp_gc11_visible_roles_mask=63)  # -> Gcode_mesh, Wasper_path, Dbg_paths, Dbg_profiles, Point_planes
mesh = Mesh(gcpath_vis.Gcode_mesh)
crv_2 = Curve(gcpath_vis.Dbg_paths)
crv_3 = Curve(gcpath_vis.Dbg_profiles)
preview = CustomPreview(Geometry=crv_3, Material=ColourSwatch(SwatchColor=RGB(0, 0, 0)))  # disabled
mjoin = MeshJoin(Meshes=mesh)

# ----
# 7. Create a WASPer Study to compare different options!!!
mat_kpis_2 = Data(mat_kpis)
gcode_3 = Data(gcode)
wsp_path_17 = Data(wsp_path_14)
in_kpis_2 = Data(in_kpis)
entwine_2 = Entwine(Branch00=in_kpis_2, Branch01=mat_kpis_2, FlattenInputs=True)  # -> flatten(Result)
kpis = Data(entwine_2)
study_manager = Wsp_Sm01_WASPerStudyManager(
    Wsp_path=wsp_path_17,
    Kpi_sets=kpis,
    Gcode=gcode_3,
    cached_kpi_sources="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",
    disabled_kpi_groups="[]",
    editor_export_layout="Iterations in rows",
    editor_file_name="WASPer_Study_1",
    editor_format="All",
    fabrication_unit_mode=-1,
    kpi_group_order="[\"Fabrication\",\"Infill\",\"Clay_Gray_100_unfired\"]",
    manager_dpi=134,
    manager_height=640,
    manager_width=1304,
    manager_x=12,
    manager_y=62,
    sample_name_tokens="iteration;kpi:infill.cell_name_short;kpi:infill.cell_count_x;kpi:infill.cell_count_y;kpi:infill.cell_count_z",
    show_kpi_values=True,
    study_slider_ids="b4fdcd23-d7b2-432b-a3dc-59283cb5704f;a8ba176b-5805-4123-9679-ea95381ad2e5",
    wasper_study_state_json="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",
    write_with_run=True)  # -> Kpi_set, Study_data, Files, Progress, Info

# ----
# Toolpath Display
# 6. Simulate Printing Process
printer_meshes = Mesh(wasper_sim.Printer_meshes)
robot_program = Data(wasper_sim.Sim_path)
wsp_path_18 = Data(wasper_sim.Wasper_path)

gcpath_vis_2 = Wsp_Pp04_VisualizePrintPath(
    Wasper_path=wsp_path_18,
    Layer_w=0,
    High_res=False,
    Sim_path=robot_program,
    Mesh=True,
    wsp_gc11_palette_index=1,
    wsp_gc11_visible_outputs_mask=0,
    wsp_gc11_visible_roles_mask=63)  # -> Gcode_mesh, Wasper_path, Dbg_paths, Dbg_profiles, Point_planes

crv_4 = Curve(gcpath_vis_2.Dbg_paths)
crv_5 = Curve(gcpath_vis_2.Dbg_profiles)
mesh_2 = Mesh(gcpath_vis_2.Gcode_mesh)
preview_2 = CustomPreview(Geometry=crv_5, Material=ColourSwatch(SwatchColor=RGB(0, 0, 0)))  # disabled

ghost_path_4 = Wsp_Pp18_GhostPath(Wasper_path=gcpath_vis_2.Wasper_path)
normalshade_2 = Wsp_Ut15_ShadeMeshByNormals(Mesh=printer_meshes, wsp_ut15_show_all_outputs=False)
