# Grasshopper definition HeatTransferNew_260622.gh (Grasshopper 1.0.8)
# plug-ins: WASPer_3DP, LadybugGrasshopper, MetaHopper

sample_files = WSP_01SampleFiles()
entwine = Entwine(Branch00=Toggle(False), Branch01=Toggle(True), FlattenInputs=True)
box = DomainBox(Base=PlaneXY(0, 0, 0), X="200", Y="100", Z="200")
brick_box_sdf = Wsp_In13_BrickLikeBoxArraySDF(
    Box=box,
    Inf_t="10",
    Shell_t="10",
    Shell_caps=False,
    Invert=entwine,
    Disjoin=False,
    Count_u=3,
    Count_v=2,
    Cav_dir=1,
    Res="2.5",
    Out_mesh=True)  # -> Mesh_out, Field, Bound_geo, Array, Cavity_size, Rib_t, Shell_t_out, Solid_vol_est, Void_vol_est, Info
tpms_box_sdf = Wsp_In08_TPMSBoxArraySDF(
    Box=box,
    Type=2,
    Level=0,
    Thickness="10",
    Shell_thickness="10",
    Shell_caps=True,
    Invert_field=entwine,
    Disjoin_mesh=False,
    Count_x="2",
    Count_y="2",
    Count_z="2",
    Phase_x=0,
    Phase_y=0,
    Phase_z=0,
    Resolution="2.5",
    Close_tpms=False,
    Out_mesh=True)  # -> Mesh_out, Field, Bound_geo, Cell_name, Array, Info

# ----
# Properties!!!!
panel = Panel("5.88")
t_in = Data("28")
t_out = Data("18")
bc_1_ch_coeff = Data("0")
bc_2_ch_coeff = Data(panel)
entwine_2 = Entwine(Branch00=t_out, Branch01=t_in, FlattenInputs=True)  # -> flatten(Result)
num = Number(entwine_2)
avr = Average(Input=num)

mesh = Mesh(brick_box_sdf.Mesh_out)
mesh_2 = Mesh(tpms_box_sdf.Mesh_out)

mesh_3 = Mesh(mesh_2)
bang = ExplodeTree(Data=mesh_3)  # -> Branch0, Branch1
voids_mesh = Mesh(bang.Branch1)
solid_mesh = Mesh(bang.Branch0)

# ----
# Scale down the B-Box a little bit
bounding_box = Data(box)
area = Area(Geometry=bounding_box)  # -> Area, Centroid
pdecon = Deconstruct(Point=area.Centroid)  # -> XComponent, YComponent, ZComponent
pt = ConstructPoint(XCoordinate=pdecon.XComponent, YCoordinate=pdecon.YComponent, ZCoordinate=pdecon.ZComponent)
scale_nu = ScaleNU(Geometry=bounding_box, Plane=area.Centroid, ScaleX="0.98", ScaleY="0.98", ScaleZ="0.98")  # -> Geometry, Transform
bounding_box_2 = Data(scale_nu.Geometry)

t_in_2 = Data(t_in)
t_out_2 = Data(t_out)

t_in_3 = Data(t_in)
t_out_3 = Data(t_out)

# ----
# Numerical Heat Transfer
solid_mesh_2 = Mesh(solid_mesh)
voids_mesh_2 = Mesh(voids_mesh)
bbox = BoundingBox(Content=bounding_box_2, Plane=PlaneXY(0, 0, 0))  # -> Box, Box_2
brep = Brep(bbox.Box)
fi3d01 = Wsp_Fi3d01_FieldFromSolid(Solid=solid_mesh_2)  # -> Field, Info
fi3d01_2 = Wsp_Fi3d01_FieldFromSolid(Solid=brep)  # -> Field, Info
debox = DeconstructBox(Box=bbox.Box)  # -> Plane, X, Y, Z
_3dgrid_field = Wsp_Gp04_3DGridSingleField(Field=flatten(fi3d01.Field), Bounding_field=fi3d01_2.Field, B_box=bbox.Box, Grid_spacing="5")  # -> Out_field, Out_b_box, Points_1, Points_2, Boundary_points, Untrimmed_grid
num_2 = Number(debox.X)
num_3 = Number(debox.Y)
num_4 = Number(debox.Z)
panel_2 = Panel([num_2, num_3, num_4])
sort_geo = Wsp_Ge04_SortGeoBrep(brep=bounding_box, list_element=Toggle(False))  # -> x_point_2, x_geo_2, y_point_2, y_geo_2, z_point_2, z_geo_2
data = Data(_3dgrid_field.Points_1)
data_2 = Data(_3dgrid_field.Points_2)
data_3 = Data(_3dgrid_field.Untrimmed_grid)
falsestart = LBFalseStartToggle(False)
void_mesh = Mesh(voids_mesh_2)
panel_3 = Panel("3")
entwine_3 = Entwine(Branch00=data, Branch01=data_2, FlattenInputs=True)
air_cavity_leq = Wsp_Ht03_EquivalentThermalConductivityAirCavitiesISO6946_v2(
    Mesh_void=void_mesh,
    Flow_vect=2,
    Bc_1_temp_in=t_in_2,
    Bc_2_temp_out=t_out_2,
    Emissivity=0.9,
    N_slices="5",
    Show_debug=falsestart)  # -> Eq_thermal_cond, Avg_eq_thermal_cond, Slices
item = ListItem(List=sort_geo.y_geo_2, Index=0, Wrap=True)  # -> Item1, Item
assign_bc_pts = Wsp_Gp05_AssignBCToPointsThermalSolver(Untrimmed_grid=data_3, Bc_1_geo=item.Item1, Bc_2_geo=item.Item)  # -> Bc_1_points, Bc_2_points
air_λeq_iso6946 = Data(air_cavity_leq.Avg_eq_thermal_cond)
points_1 = Data(entwine_3)
clay_w_mk = Panel("0.756")
air_eq_w_mk = Panel(air_λeq_iso6946)
solid_thermal_cond = Data(clay_w_mk)
air_λeq_iso6946_2 = Data(air_λeq_iso6946)
entwine_4 = Entwine(Branch00=solid_thermal_cond, Branch01=air_λeq_iso6946_2, FlattenInputs=True)  # -> flatten(Result)
k = Data(entwine_4)
toggle = GroupToggle(ToggleActive=True, ToggleVisible=False)  # disabled

solid_mesh_3 = Mesh(solid_mesh_2)

bc_1_points = Data(assign_bc_pts.Bc_1_points)
bc_2_points = Data(assign_bc_pts.Bc_2_points)

heat_transfer_num = Wsp_Ht03_NumericalSolverConduction(
    Mat_pts=points_1,
    T_conductivities=flatten(k),
    Bc_1_points_in=bc_1_points,
    Bc_2_points_out=bc_2_points,
    Bc_1_temp_in=t_in_3,
    Bc_2_temp_out=t_out_3,
    Bc_1_ht_coeff_in=-1,
    Bc_2_ht_coeff_out=-1,
    Units_m_mm=False,
    Decimals=3,
    Red_pts_viz="0.1",
    Run=True)  # -> Boundary_area, Heat_flow_direction, Heat_flux_W, Heat_flux_W_per_m2, Heat_flux_W_speci, U, ThermalResistance, ThermResistanceSpeci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
heat_flow_direction = Panel(heat_transfer_num.Heat_flow_direction)
k_eff_w_mk = Panel(heat_transfer_num.K_eff_total)
heat_flow_w = Panel(heat_transfer_num.Heat_flux_W)
specific_heat_flow_w_m² = Panel(heat_transfer_num.Heat_flux_W_speci)
u_value_w_m²k = Panel(heat_transfer_num.U)
resistance_m²k_w = Panel(heat_transfer_num.ThermResistanceSpeci)
conductance_w_m²k = Panel(heat_transfer_num.ThermConductanceSpeci)
therm_λ_eff_total_num_iso6946 = Data(heat_transfer_num.K_eff_total)
therm_r_num_iso6946 = Data(heat_transfer_num.ThermResistanceSpeci)

points = Data(flatten(heat_transfer_num.Out_pts))
temps = Data(flatten(heat_transfer_num.Temps))
series = Series(Start=0, Step=1, Count=10)
solid_box_mesh = Mesh(solid_mesh_3)
bnd = Bounds(Numbers=series)
dedomain = DeconstructDomain(Domain=bnd)  # -> Start, End
gradient = Gradient(
    LowerLimit=dedomain.End,
    UpperLimit=dedomain.Start,
    Parameter=series,
    stops=[0: RGB(158, 0, 65), 0.0312: RGB(175, 20, 70), 0.0625: RGB(192, 39, 74), 0.0938: RGB(209, 58, 78), 0.125: RGB(220, 73, 75), 0.156: RGB(230, 88, 72)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])
bnd_2 = Bounds(Numbers=temps)
cset = CreateSet(List=gradient)  # -> Set, Map
dedomain_2 = DeconstructDomain(Domain=bnd_2)  # -> Start, End
color_mesh_thermal = Wsp_Ht07_ColorMeshWithThermalValues(
    Meshes=flatten(solid_box_mesh),
    Pts=flatten(points),
    Values=flatten(temps),
    Colors=flatten(cset.Set),
    V_min=dedomain_2.Start,
    V_max=dedomain_2.End,
    Use_average=True)  # -> Meshes_col, V_values, V_colors, Summary
mesh_4 = Mesh(color_mesh_thermal.Meshes_col)

# ----
# Temperatures
points_2 = Data(flatten(heat_transfer_num.Out_pts))
data_viz = Data(flatten(heat_transfer_num.Temps))
bnd_3 = Bounds(Numbers=data_viz)
dedomain_3 = DeconstructDomain(Domain=bnd_3)  # -> Start, End
gradient_2 = Gradient(
    LowerLimit=dedomain_3.End,
    UpperLimit=dedomain_3.Start,
    Parameter=data_viz,
    stops=[0: RGB(158, 0, 65), 0.0312: RGB(175, 20, 70), 0.0625: RGB(192, 39, 74), 0.0938: RGB(209, 58, 78), 0.125: RGB(220, 73, 75), 0.156: RGB(230, 88, 72)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])
preview = CustomPreview(Geometry=points_2, Material=gradient_2)  # disabled

# ==== cluster Wsp_Ge04_SortGeoBrep
b_box_bool = ClusterInput()
list_element = ClusterInput()
brep = ClusterInput()
list_element_2 = Boolean(list_element)
b_box_bool_2 = Boolean(b_box_bool)
py3 = PyTemplate(x=b_box_bool_2)  # -> a
# ---------- py3: Python ----------
"""Grasshopper Script"""

import System
import Rhino
import Grasshopper
import Rhino.Geometry as rg
import rhinoscriptsyntax as rs

ghenv.Component.Name = "Py Template"
ghenv.Component.Nickname = ""
ghenv.Component.Message = ""
ghenv.Component.Cathegory = ""
ghenv.Component.Description = ""

x = x if x else False

a = x
print(a)
# ---------- end py3 ----------
py3_2 = PyTemplate(x=list_element_2)  # -> a; same code as py3

brep_2 = Geometry(brep)
bbox = BoundingBox(Content=flatten(brep_2), Plane=PlaneXY(0, 0, 0), UnionBox=True)  # -> Box, Box_2
tstat = TreeStatistics(Tree=brep_2)  # -> Paths, Length, Count
larger = LargerThan(FirstNumber=tstat.Count, SecondNumber="1")  # -> LargerThan, OrEqualTo

filter = StreamFilter(Gate=py3, Stream0=brep_2, Stream1=bbox.Box)  # -> simplify(Stream)

debrep = DeconstructBrep(Brep=filter)  # -> Faces, Edges, Vertices
flatten = FlattenTree(Tree=debrep.Faces, Path="{0}")
filter_2 = StreamFilter(Gate=larger.LargerThan, Stream0=flatten, Stream1=debrep.Faces)

path_mapper = PathMapper(filter_2, source=["{A}", "{A;B}", "{A;B;C}"], target=["{A}", "{A}", "{A}"])

data = Data(path_mapper)
area = Area(Geometry=data)  # -> Area, Centroid
pdecon = Deconstruct(Point=area.Centroid)  # -> XComponent, YComponent, ZComponent
sort = SortList(Keys=pdecon.XComponent, ValuesA=area.Centroid)  # -> Keys, ValuesA
item = ListItem(List=sort.ValuesA, Index=0, Wrap=True)

sort_2 = SortList(Keys=pdecon.XComponent, ValuesA=data)  # -> Keys, ValuesA
sort_3 = SortList(Keys=pdecon.YComponent, ValuesA=area.Centroid)  # -> Keys, ValuesA
sort_4 = SortList(Keys=pdecon.YComponent, ValuesA=data)  # -> Keys, ValuesA
sort_5 = SortList(Keys=pdecon.ZComponent, ValuesA=area.Centroid)  # -> Keys, ValuesA
sort_6 = SortList(Keys=pdecon.ZComponent, ValuesA=data)  # -> Keys, ValuesA
item_2 = ListItem(List=sort_2.ValuesA, Index=0, Wrap=True)
item_3 = ListItem(List=sort_3.ValuesA, Index=0, Wrap=True)
item_4 = ListItem(List=sort_4.ValuesA, Index=0, Wrap=True)
item_5 = ListItem(List=sort_5.ValuesA, Index=0, Wrap=True)
item_6 = ListItem(List=sort_6.ValuesA, Index=0, Wrap=True)
filter_3 = StreamFilter(Gate=py3_2, Stream0=sort.ValuesA, Stream1=item)
filter_4 = StreamFilter(Gate=py3_2, Stream0=sort_2.ValuesA, Stream1=item_2)
filter_5 = StreamFilter(Gate=py3_2, Stream0=sort_3.ValuesA, Stream1=item_3)
filter_6 = StreamFilter(Gate=py3_2, Stream0=sort_4.ValuesA, Stream1=item_4)
filter_7 = StreamFilter(Gate=py3_2, Stream0=sort_5.ValuesA, Stream1=item_5)
filter_8 = StreamFilter(Gate=py3_2, Stream0=sort_6.ValuesA, Stream1=item_6)

x_point = Point(filter_3)

y_point = Point(filter_5)
z_geo = Brep(filter_8)
x_geo = Brep(filter_4)
y_geo = Brep(filter_6)
z_point = Point(filter_7)
x_geo_2 = ClusterOutput(x_geo)
y_point_2 = ClusterOutput(y_point)
y_geo_2 = ClusterOutput(y_geo)
z_point_2 = ClusterOutput(z_point)
z_geo_2 = ClusterOutput(z_geo)
x_point_2 = ClusterOutput(x_point)
