# Grasshopper definition Implicit_260807.gh (Grasshopper 1.0.8)
# plug-ins: WASPer_3DP

series = Series(Start=0, Step=Slider(200, range=1..500), Count="2")
pt = ConstructPoint(XCoordinate=0, YCoordinate=0, ZCoordinate=series)
pline = PolyLine(Vertices=pt, Closed=False)
crv = Curve(pline)

crv_2 = Curve(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)
crv_3 = Curve(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)
mm = Panel("6")
mm_2 = Panel("2")
ref_curve = Curve(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)

layer_height = Data(mm_2)
layer_width = Data(mm)

len = Length(Curve=ref_curve)
division = Division(A=len, B=layer_height)
round = Round(Number=division)  # -> Nearest, Floor, Ceiling

# ----
# Frame parameters
number_slider = Slider(100, range=10..100)
range = Range(Domain=Domain(0, 1), Steps=round.Ceiling)

frame_size = Data(Slider(130, range=10..200))
resolution = Data(Slider(2, range=0.5..20))
range_2 = Data(range)

paint_distfield = Wsp_Fi01_PaintDistanceField2D(
    Iso_offset=0,
    Resolution=resolution,
    Frame_size=frame_size,
    wsp_fi01_paint_field_collection="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",
    wsp_fi01_paint_field_state="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")  # -> Field_mesh, Field_obj
graph = GraphMapper(range_2, x0=0, x1=1, y0=0, y1=1, container_name="Sine", Equation_px=[0, 0.4220771194], Equation_py=[0, 1])
contours = Wsp_Fi05_ContoursFromFields(Field_obj=paint_distfield.Field_obj, Offset=0)

range_3 = Data(range_2)
ref_curve_2 = Curve(ref_curve)
blendfield = Wsp_Fi03_BlendFields(Field_obj=paint_distfield.Field_obj, Range=graph)
fields_frames = Wsp_Fi04_FieldsToFrames(Axis_curve=ref_curve_2, Interp_field_obj=blendfield, Range=range_3, Flip_ends=Toggle(False))  # -> Field_mesh, Field_obj, Field_frames

ref_curve_3 = Curve(ref_curve)
number_slider_2 = Slider(1.19, range=0.1..10)
bbox = BoundingBox(Content=ref_curve_3, Plane=PlaneXY(0, 0, 0))  # -> Box, Box_2
area = Area(Geometry=bbox.Box)  # -> Area, Centroid
dom = ConstructDomain(DomainStart=expr("-x/2", "200"), DomainEnd=expr("x/2", "200"))
dom_2 = ConstructDomain(DomainStart=expr("-x/2", "250"), DomainEnd=expr("x/2", "250"))
box = DomainBox(Base=area.Centroid, X=dom, Y=dom, Z=dom_2)
contours_2 = Wsp_Fi05_ContoursFromFields(Field_obj=fields_frames.Field_obj, Offset=0)
pt_2 = Point(Point(51.83657557, -9.521416188, 104.2204238))
wires = BrepWireframe(Brep=box, Density=-1)
sph = Sphere(Base=pt_2, Radius=Slider(30, range=10..50))
geo = Geometry(sph)
printing_path_crvs = Data(simplify(contours_2))
meshfields = Wsp_Fi06_MeshFromFields(
    Field_obj=fields_frames.Field_obj,
    Iso_level=0,
    Resolution=0,
    Cap_ends=True,
    Disjoin_mesh=False,
    Clean_mesh=True,
    Mesh=True)  # -> Mesh_out, Field, Sample_frames, Info
fi3d01 = Wsp_Fi3d01_FieldFromSolid(Solid=geo)  # -> Field, Info
entwine = Entwine(Branch00=meshfields.Field, Branch01=fi3d01.Field, FlattenInputs=True)
field3d_bool = Wsp_Fi3d04_Field3DBooleans(Fields=flatten(entwine), Res="5", Mesh=invert(True), Boolean_op=Slider(1, range=1..5))  # -> Field_result, Result_mesh
wasper_ghost_field = Wsp_Fi3d12_WASPerGhostField(Field=field3d_bool.Field_result, Box=box, Res="6", Mesh=False, Opacity=1)  # -> Mesh, Field, Info; disabled
panel = Panel(printing_path_crvs)
pln = Plane(fields_frames.Field_frames)

layer_height_2 = Data(layer_height)
layer_width_2 = Data(layer_width)

panel_2 = Panel("""Sample information:
Sample Name...
Hello...""")

reprap_wiki_link = Panel("https://reprap.org/wiki/G-code")
marlin_link = Panel("https://marlinfw.org/meta/gcode/")
linkedin_profile_link = Panel("https://www.linkedin.com/in/juan-diego-vargas-vel/")
open_url = Wsp_Ut06_OpenURL(link=reprap_wiki_link, run=Button())  # inputs run: Boolean
# ---------- open_url: Python ----------
ghenv.Component.Name = "wsp_Ut06_Open URL"
ghenv.Component.Nickname = "Open url"
ghenv.Component.Message = "v1.0.4"
ghenv.Component.Cathegory = "WASPer_3DP"
ghenv.Component.Subcathegory = "1_Utils"
ghenv.Component.Description = "This utility component opens URLs"

import webbrowser

# Grasshopper inputs

# Function to open the link
def open_link(link):
    webbrowser.open(link)

# Check if the button is pressed and run only once
if run:
    if 'run_once' not in globals():
        run_once = False
    if not run_once:
        if link:
            open_link(link)
            run_once = True
else:
    run_once = False  # Reset the run_once flag when the button is not pressed
# ---------- end open_url ----------
open_url_2 = Wsp_Ut06_OpenURL(link=marlin_link, run=Button())  # inputs run: Boolean; same code as open_url
open_url_3 = Wsp_Ut06_OpenURL(link=linkedin_profile_link, run=Button())  # inputs run: Boolean; same code as open_url

# ----
# Distance field 1
crv_4 = Curve(crv_2)
crv_5 = Curve(crv_4)
number_slider_3 = Slider(10, range=0..50)

data = Data(crv_5)
bbox_2 = BoundingBox(Content=data, Plane=PlaneXY(0, 0, 0), UnionBox=True)  # -> Box, Box_2
srf = Surface(bbox_2.Box)
area_2 = Area(Geometry=srf)  # -> Area, Centroid
xy = XYPlane(Origin=area_2.Centroid)

paint_distfield_2 = Wsp_Fi01_PaintDistanceField2D(
    Curves=crv_5,
    Ref_plane=xy,
    Iso_offset=0,
    Resolution=resolution,
    Frame_size=frame_size,
    wsp_fi01_paint_field_collection="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",
    wsp_fi01_paint_field_state="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")  # -> Field_mesh, Field_obj

dist_field_1 = Data(paint_distfield_2.Field_obj)
mesh = Mesh(paint_distfield_2.Field_mesh)

contours_3 = Wsp_Fi05_ContoursFromFields(Field_obj=dist_field_1, Offset=0)
dist_field_1_2 = Data(dist_field_1)
defield = Wsp_Fi06_DeconstructField(Field_obj=dist_field_1_2)  # -> G_values, Nx_verts, Ny_verts, Plane, Center_xy, Frame_size, Cell_size, Iso_offset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
demesh = DeconstructMesh(Mesh=defield.Field_mesh)  # -> Vertices, Faces, Colours, Normals
round_num = Wsp_Ut05_RoundNumber(num=defield.G_values, d="2")  # -> rn; inputs num: list of Double, d: Int32
# ---------- round_num: Python ----------
ghenv.Component.Name = "wsp_Ut05_Round Number"
ghenv.Component.Nickname = "Round"
ghenv.Component.Message = "v1.0.4"
ghenv.Component.Cathegory = "WASPer_3DP"
ghenv.Component.Subcathegory = "1_Utils"
ghenv.Component.Description = "This utility component rounds numbers"

# round_num = round(num,decimals)
empty_list = []
num = num if num else empty_list
d = d if d else 1

round_num = []

def round_float(numbers, decimals):
    for number in numbers:
        rounded_number = round(number,decimals)
        round_num.append(rounded_number)
    return round_num

rn = round_float(num,d)
# ---------- end round_num ----------
tag = TextTag(Location=demesh.Vertices, Text=round_num)
tag_2 = TextTag3D(Location=demesh.Vertices, Text=round_num, Size=number_slider_2, Justification=5)

# ----
# Distance field 2
crv_6 = Curve(crv_3)
crv_7 = Curve(crv_6)

data_2 = Data(crv_7)
bbox_3 = BoundingBox(Content=data_2, Plane=PlaneXY(0, 0, 0), UnionBox=True)  # -> Box, Box_2
srf_2 = Surface(bbox_3.Box)
area_3 = Area(Geometry=srf_2)  # -> Area, Centroid
xy_2 = XYPlane(Origin=area_3.Centroid)

paint_distfield_3 = Wsp_Fi01_PaintDistanceField2D(
    Curves=crv_7,
    Ref_plane=xy_2,
    Iso_offset=Slider(5, range=0..5),
    Resolution=resolution,
    Frame_size=frame_size,
    wsp_fi01_paint_field_collection="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",
    wsp_fi01_paint_field_state="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")  # -> Field_mesh, Field_obj
panel_3 = Panel(paint_distfield_3.Field_obj)

dist_field_2 = Data(paint_distfield_3.Field_obj)
mesh_2 = Mesh(paint_distfield_3.Field_mesh)

contours_4 = Wsp_Fi05_ContoursFromFields(Field_obj=dist_field_2, Offset=0)
dist_field_2_2 = Data(dist_field_2)
defield_2 = Wsp_Fi06_DeconstructField(Field_obj=dist_field_2_2)  # -> G_values, Nx_verts, Ny_verts, Plane, Center_xy, Frame_size, Cell_size, Iso_offset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
demesh_2 = DeconstructMesh(Mesh=defield_2.Field_mesh)  # -> Vertices, Faces, Colours, Normals
round_num_2 = Wsp_Ut05_RoundNumber(num=defield_2.G_values, d="2")  # -> rn; inputs num: list of Double, d: Int32; same code as round_num
tag_3 = TextTag(Location=demesh_2.Vertices, Text=round_num_2)
tag_4 = TextTag3D(Location=demesh_2.Vertices, Text=round_num_2, Size=number_slider_2, Justification=5)

crv_8 = Curve(printing_path_crvs)

bbox_4 = BoundingBox(Content=crv_8, Plane=PlaneXY(0, 0, 0), UnionBox=True)  # -> Box, Box_2
debrep = DeconstructBrep(Brep=bbox_4.Box)  # -> Faces, Edges, Vertices
item = ListItem(List=debrep.Vertices, Index=Slider(3, range=0..3), Wrap=True)
pt_3 = Point(item)

crv_cp = CurveClosestPoint(Point=pt_3, Curve=crv_8)  # -> Point, Parameter, Distance
seam = Seam(Curve=crv_8, Seam=crv_cp.Parameter)  # -> simplify(Curve)

printing_path_crvs_2 = Data(seam)
curve_roles = Wsp_Sl08_AssignCurveRoles(Path_curves=printing_path_crvs_2, Path_role=flatten(1))  # -> Tagged_curves, Summary

printing_path_crvs_3 = Data(curve_roles.Tagged_curves)
la_planes = Data(pln)
pathcrvs_v2 = Wsp_Pp01_WASPerPathFromCurvesV2(
    Printing_path=printing_path_crvs_3,
    Layer_planes=la_planes,
    Segment_len=layer_height_2,
    Ref_plane=PlaneXY(0, 0, 0),
    Layer_w=layer_width_2,
    Plane_mode=Slider(0, range=0..1),
    WASPer_Pp01v3_ShellSeamDisplay=0,
    WASPer_Pp01v3_ShellSeamFrom=0,
    WASPer_Pp01v3_ShellSeamOverrides="{}",
    WASPer_Pp01v3_ShellSeamScope=0,
    WASPer_Pp01v3_ShellSeamTo=0,
    wsp_gc01_v2_visible_outputs_mask=0)  # -> Wsp_path, Summary
wsp_path = Data(pathcrvs_v2.Wsp_path)

panel_4 = Panel(pathcrvs_v2.Summary)

wsp_path_2 = Data(wsp_path)
path_optimizer = Wsp_Pp03_PrintingPathOptimizer(Wsp_path=wsp_path_2, Ref_point=null, Target_roles=flatten(0), wsp_gc05_visible_outputs_mask=0)  # -> Wsp_path, Summary
wsp_path_3 = Data(path_optimizer.Wsp_path)

mm_3 = Panel("4")
wsp_path_4 = Data(wsp_path_3)
nozzle_diam = Number(mm_3)
ldm_3dp_params = Wsp_Gc01_LDM3DPParameters(Nozzle_diameter=nozzle_diam, Z_hop="6")  # -> _3dp_params, Info
marlin_gcode = Wsp_Gc03_MarlinGcodeV2(
    Wasper_path=wsp_path_4,
    _3dp_params=ldm_3dp_params._3dp_params,
    Sample_info=panel_2,
    Kpi_units=0,
    wsp_gc04_show_all_outputs=False)  # -> Wasper_path, G_code, Point_planes, Travel_planes
wsp_path_5 = Data(marlin_gcode.Wasper_path)
gcode = Data(marlin_gcode.G_code)

wsp_path_6 = Data(wsp_path_3)
wsp_path_7 = Data(wsp_path_3)
wsp_path_8 = Data(wsp_path_3)
curvspeed = Wsp_Pp08_SpeedFromCurvature(
    Wsp_path=wsp_path_6,
    S_min="3000",
    S_max="5000",
    Curv_mode=0,
    Smooth_window=3,
    Curv_percentile=0.95,
    Norm_curv=False,
    Target_roles=flatten(0),
    wsp_gc08_visible_outputs_mask=0)  # -> Wsp_path, Summary
proxflow = Wsp_Pp15_FlowFromProximity(
    Wsp_path=wsp_path_7,
    Min_flux=0.6,
    Max_flux=1,
    D_crit=2,
    D_safe=6,
    Cluster_mode=2,
    Curv_threshold=0.3,
    Zone_half_width=2,
    Target_roles=flatten(0),
    wsp_gc06_visible_outputs_mask=0)  # -> Wsp_path, Summary
reduce_path_pls = Wsp_Pp07_ReducePathPoints(
    Wsp_path=wsp_path_8,
    Deviation_tol=0.5,
    Curv_angle=5,
    Max_spacing=0,
    Target_roles=flatten(0),
    wsp_gc07_visible_outputs_mask=0)  # -> Wsp_path, Summary
wsp_path_9 = Data(reduce_path_pls.Wsp_path)
wsp_path_10 = Data(curvspeed.Wsp_path)
wsp_path_11 = Data(proxflow.Wsp_path)

panel_5 = Panel(ldm_3dp_params._3dp_params)
panel_6 = Panel(gcode)

panel_7 = Panel("""400
1000""")
wsp_path_12 = Data(wsp_path_5)
pt_4 = Point(Point(255.3702787, 189.8171267, 0))
panel_8 = Panel("1")
wasper_sim = Wsp_Gc05_WASPerSimulation(
    Wasper_path=wsp_path_12,
    Origin_plane=PlaneXY(0, 0, 0),
    Printer="1",
    Print_dimensions=panel_7,
    Preview_time=1,
    Start_time=0,
    Normalized=True,
    wsp_gc15_show_all_outputs=False)  # -> Printer_meshes, Wasper_path, Sim_path

gcode_2 = Data(gcode)
gc06_ppath = Wsp_Gc06_WASPerPathFromGcode(Gcode_text=gcode_2, Include_travels=True, wsp_gc13_show_all_outputs=False)  # -> Wasper_path, Gcode_p_path, Gcode_travels, Summary
layer_w = Data("6")
pathcrvs_v2_2 = Wsp_Pp01_WASPerPathFromCurvesV2(
    Printing_path=gc06_ppath.Gcode_p_path,
    Segment_len="4",
    Ref_plane=PlaneXY(0, 0, 0),
    Layer_w=layer_w,
    Plane_mode=0,
    WASPer_Pp01v3_ShellSeamDisplay=0,
    WASPer_Pp01v3_ShellSeamFrom=0,
    WASPer_Pp01v3_ShellSeamOverrides="{}",
    WASPer_Pp01v3_ShellSeamScope=0,
    WASPer_Pp01v3_ShellSeamTo=0,
    wsp_gc01_v2_visible_outputs_mask=0)  # -> Wsp_path, Summary

wsp_path_13 = Data(pathcrvs_v2_2.Wsp_path)
gcpath_vis = Wsp_Pp04_VisualizePrintPath(
    Wasper_path=wsp_path_13,
    Layer_w=0,
    High_res=False,
    Mesh=True,
    wsp_gc11_palette_index=0,
    wsp_gc11_visible_outputs_mask=0,
    wsp_gc11_visible_roles_mask=63)  # -> Gcode_mesh, Wasper_path, Dbg_paths, Dbg_profiles, Point_planes
crv_9 = Curve(gcpath_vis.Dbg_paths)
mesh_3 = Mesh(gcpath_vis.Gcode_mesh)
crv_10 = Curve(gcpath_vis.Dbg_profiles)
preview = CustomPreview(Geometry=crv_10, Material=ColourSwatch(SwatchColor=RGB(0, 0, 0)))  # disabled
mjoin = MeshJoin(Meshes=mesh_3)

printer_meshes = Mesh(wasper_sim.Printer_meshes)
wsp_path_14 = Data(wasper_sim.Wasper_path)
robot_program = Data(wasper_sim.Sim_path)

gcpath_vis_2 = Wsp_Pp04_VisualizePrintPath(
    Wasper_path=wsp_path_14,
    Layer_w=0,
    High_res=False,
    Sim_path=robot_program,
    Mesh=True,
    wsp_gc11_palette_index=1,
    wsp_gc11_visible_outputs_mask=0,
    wsp_gc11_visible_roles_mask=63)  # -> Gcode_mesh, Wasper_path, Dbg_paths, Dbg_profiles, Point_planes

crv_11 = Curve(gcpath_vis_2.Dbg_paths)
crv_12 = Curve(gcpath_vis_2.Dbg_profiles)
mesh_4 = Mesh(gcpath_vis_2.Gcode_mesh)

normalshade = Wsp_Ut15_ShadeMeshByNormals(Mesh=printer_meshes, wsp_ut15_show_all_outputs=False)
