# Grasshopper definition Implicit_Isopod_to_WASPer_260807.gh (Grasshopper 1.0.8)
# plug-ins: WASPer_3DP, Ghost, Isopod

number_slider = Slider(10, range=10..200)
tpms_params = Wsp_In11_TPMSInfillParamsLayeredVolumetric(
    Type=Slider(7, range=0..7),
    Level=Slider(0, range=0..1),
    Count_x="2",
    Count_y="2",
    Count_z="2",
    Phase_x=0,
    Phase_y=0,
    Phase_z=0,
    Close_tpms=False,
    Invert_tpms=False)
xy = XYPlane(Origin=Point(0, 0, 0))
box = DomainBox(Base=PlaneXY(0, 0, 0), X="200", Y="200", Z="200")
pt = Point(Point(19.96591264, -0.4139784946, 0))

data = Data(box)
area = Area(Geometry=data)  # -> Area, Centroid
scale = Scale(Geometry=data, Center=area.Centroid, Factor="1.1")  # -> Geometry, Transform

spheresdf = SphereSDF(center=pt, radius=number_slider)  # -> out, a; inputs center: Point3d
# ---------- spheresdf: C# ----------
// Grasshopper Script Instance
#region Usings
#r "Isopod.dll"
using Isopod;
using System;
using System.Linq;
using System.Collections;
using System.Collections.Generic;
using System.Drawing;

using Rhino;
using Rhino.Geometry;

using Grasshopper;
using Grasshopper.Kernel;
using Grasshopper.Kernel.Data;
using Grasshopper.Kernel.Types;
#endregion

public class Script_Instance : GH_ScriptInstance
{
    #region Notes
    /* 
      Members:
        RhinoDoc RhinoDocument
        GH_Document GrasshopperDocument
        IGH_Component Component
        int Iteration

      Methods (Virtual & overridable):
        Print(string text)
        Print(string format, params object[] args)
        Reflect(object obj)
        Reflect(object obj, string method_name)
    */
    #endregion

    private void RunScript(Point3d center, object radius, ref object a)
    {
        a = new SphereSDF(center,radius);
    }

    public class SphereSDF : Field
  {
    Point3d center;
    double radiusD;
    IField radiusF;

    public SphereSDF(Point3d center, object radius)
    {
      this.center = center;
      if(radius is double r) radiusD  = r ;
      else radiusF = radius as IField;
    }
    public override double ValueAt(Point3d P)
    {
      return P.DistanceTo(center) - (radiusF==null ? radiusD : radiusF.ValueAt(P));      
    }
  }
}
# ---------- end spheresdf ----------
spheresdf_2 = SphereSDF(center=xy, radius=number_slider)  # -> out, a; inputs center: Point3d; same code as spheresdf
box_2 = CenterBox(Base=xy, X=number_slider, Y=number_slider, Z=number_slider)
vol_infill_box = Wsp_In08_VolumetricInfillFromBox(
    Box=box,
    Infill_params=flatten(tpms_params),
    Thickness="5",
    Shell_thickness="5",
    Shell_caps=True,
    Resolution="1",
    Out_mesh=invert(True))  # -> Mesh_out, Field, Bound_geo, Cell_name, Array, Info, Infill_kpis
smoothunion_lists = SmoothUnion_lists(fa=spheresdf_2.a, fb=spheresdf.a, k=0.3)  # -> out, a; inputs fa: list, fb: list, k: Double
# ---------- smoothunion_lists: C# ----------
// Grasshopper Script Instance
#region Usings
#r "Isopod.gha"
using Isopod;
using System;
using System.Linq;
using System.Collections;
using System.Collections.Generic;
using System.Drawing;

using Rhino;
using Rhino.Geometry;

using Grasshopper;
using Grasshopper.Kernel;
using Grasshopper.Kernel.Data;
using Grasshopper.Kernel.Types;
#endregion

public class Script_Instance : GH_ScriptInstance
{
    #region Notes
    /* 
      Members:
        RhinoDoc RhinoDocument
        GH_Document GrasshopperDocument
        IGH_Component Component
        int Iteration
    */
    #endregion

    private void RunScript(List<object> fa, List<object> fb, double k, ref object a)
    {
        a = null;

        // Validate input
        if (fa == null || fb == null || fa.Count == 0 || fb.Count == 0)
        {
            return; // Exit silently if nothing is connected
        }

        // Convert to IField, ignore any nulls
        List<IField> fieldsA = fa.OfType<IField>().Where(f => f != null).ToList();
        List<IField> fieldsB = fb.OfType<IField>().Where(f => f != null).ToList();

        if (fieldsA.Count == 0 && fieldsB.Count == 0)
        {
            return; // Nothing to process
        }

        List<IField> allFields = new List<IField>();
        allFields.AddRange(fieldsA);
        allFields.AddRange(fieldsB);

        a = new SmoothUnionMultiple(allFields, k);
    }

    public class SmoothUnionMultiple : Field
    {
        private List<IField> fields;
        private double k;

        public SmoothUnionMultiple(List<IField> fields, double k)
        {
            this.fields = fields;
            this.k = k;
        }

        public override double ValueAt(Point3d P)
        {
            if (fields.Count == 0) return 0;

            double result = fields[0].ValueAt(P);
            for (int i = 1; i < fields.Count; i++)
            {
                result = Utils.smoothUnion(result, fields[i].ValueAt(P), k);
            }
            return result;
        }
    }
}
# ---------- end smoothunion_lists ----------
isopod_wasper = Wsp_Fi3d10_IsopodToWASPerField(Isopod_field=spheresdf_2.a, Domain=box_2, Res=2, Mesh=True, Label="Isopod field")  # -> Mesh, Wasper_field, Source_type, Info
wasper_isopod = Wsp_Fi3d11_WASPerToIsopodField(Wasper_field=vol_infill_box.Field)  # -> Isopod_field, Adapter_type
boxsdf = BoxSDF(box=scale.Geometry, rounding=0.5)  # -> out, a; inputs rounding: Double
# ---------- boxsdf: C# ----------
// Grasshopper Script Instance
#region Usings
#r "Isopod.dll"
using Isopod;
using System;
using System.Linq;
using System.Collections;
using System.Collections.Generic;
using System.Drawing;

using Rhino;
using Rhino.Geometry;

using Grasshopper;
using Grasshopper.Kernel;
using Grasshopper.Kernel.Data;
using Grasshopper.Kernel.Types;
#endregion

public class Script_Instance : GH_ScriptInstance
{
    #region Notes
    /* 
      Members:
        RhinoDoc RhinoDocument
        GH_Document GrasshopperDocument
        IGH_Component Component
        int Iteration

      Methods (Virtual & overridable):
        Print(string text)
        Print(string format, params object[] args)
        Reflect(object obj)
        Reflect(object obj, string method_name)
    */
    #endregion

    private void RunScript(object box, double rounding, ref object a)
    {
        Box boxA = new Box();
        if(box is Box b) boxA = b;
        else
        {
            Brep brp = box as Brep;
            Plane p = new Plane();
            brp.Surfaces[0].FrameAt(0, 0, out p);
            brp.GetBoundingBox(p, out b);
            boxA = b;
        }
        a = new BoxSDF(boxA,rounding);
    }

    public class BoxSDF : Field
  {
    Box b;
    double R;

    public BoxSDF(Box b, double round)
    {
      b.RepositionBasePlane(b.PointAt(0.5, 0.5, 0.5));
      this.b = b;
      this.R = round;
    }
    public override double ValueAt(Point3d P)
    {
      P.Transform(Transform.PlaneToPlane(b.Plane, Plane.WorldXY));
      Vector3d q = new Vector3d(Math.Abs(P.X) - b.X.T1, Math.Abs(P.Y) - b.Y.T1, Math.Abs(P.Z) - b.Z.T1);
      return new Vector3d(Math.Max(q.X, 0.0), Math.Max(q.Y, 0.0), Math.Max(q.Z, 0.0)).Length
        + Math.Min(Math.Max(q.X, Math.Max(q.Y, q.Z)), 0.0) - R;    
    }
  }
}
# ---------- end boxsdf ----------
swatch = ColourSwatch(SwatchColor=RGB(255, 0, 0))
smoothintersection = SmoothIntersection(fa=wasper_isopod.Isopod_field, fb=boxsdf.a, k=0.3)  # -> out, a; inputs k: Double
# ---------- smoothintersection: C# ----------
// Grasshopper Script Instance
#region Usings
#r "Isopod.gha"
using Isopod;
using System;
using System.Linq;
using System.Collections;
using System.Collections.Generic;
using System.Drawing;

using Rhino;
using Rhino.Geometry;

using Grasshopper;
using Grasshopper.Kernel;
using Grasshopper.Kernel.Data;
using Grasshopper.Kernel.Types;
#endregion

public class Script_Instance : GH_ScriptInstance
{
    #region Notes
    /* 
      Members:
        RhinoDoc RhinoDocument
        GH_Document GrasshopperDocument
        IGH_Component Component
        int Iteration

      Methods (Virtual & overridable):
        Print(string text)
        Print(string format, params object[] args)
        Reflect(object obj)
        Reflect(object obj, string method_name)
    */
    #endregion

    private void RunScript(object fa, object fb, double k, ref object a)
    {       
        a = new SmoothIntersect(fa as IField,fb as IField,k);
    }

    public class SmoothIntersect : Field 
  {    
    IField fa,fb;
    double k;

    public SmoothIntersect(IField fa,IField fb,double k)
    {      
      this.k = k;
      this.fa = fa;
      this.fb = fb;
    }
    public override double ValueAt(Point3d P)
    {        
        return Utils.smoothIntersect(fa.ValueAt(P),fb.ValueAt(P),k);        
    }
  } 
}
# ---------- end smoothintersection ----------
mesh_field = Wsp_Fi3d02_MeshFromField(Field=isopod_wasper.Wasper_field, Iso_level=0, Resolution=2, Disjoin_mesh=False, Clean_mesh=True)  # -> Mesh_out, Sample_box, Info
mesh = Mesh(mesh_field.Mesh_out)
field_preview = Wsp_Fi3d12_FieldPreview(Field=vol_infill_box.Field, Box=scale.Geometry, Res=2, Mesh=False, Color=RGB(54, 164, 221), Opacity=1)  # -> Mesh, Field, Info
isomesh2 = IsoMesh2(Field=smoothintersection.a, Box=scale.Geometry, Resolution=Slider(200, range=20..200), RootFindingMaxSteps=10)  # disabled
ghost = GhostSDFPreview(Field=smoothintersection.a, Box=scale.Geometry, Resolution=Slider(100, range=20..100), Iso=0)
